# Requirement set Table_of_Requirements (R2024b)

Attributes:
- Classification: Imported from Excel:Classification
- Date: Imported from Excel:Date
- Objective: Imported from Excel:Objective
- Required By: Imported from Excel:Required By
- Values: Imported from Excel:Values

## 1 [Table_of_Requirements!Requirements] References to Table_of_Requirements.xlsx (Requirements) (Container)
Read-only references to Microsoft Excel document.
Comment: There are no changes

### 1.1 [1] Cost
The aircraft must be extremely affordable, or cannot be manufactured due to strict budgetary constraints.
Classification: MUST
Date: 9/27/2024
Objective: Flyaway Cost <  $20 million per aircraft
Required By: RFP
Values: Flyaway Cost < $25 million per aircraft

### 1.2 [2] Manufacturing
There shall be a minimum number of aircraft produced
Classification: SHALL
Date: 9/27/2024
Objective: 1000
Required By: RFP
Values: 1000

### 1.3 [3] Structures
The aircraft must have specific design load factors in clean configuration with 50% internal fuel
Classification: MUST
Date: 9/27/2024
Objective: +7 and -3 vertical g's
Required By: RFP
Values: +7 and -3 vertical g's

### 1.4 [4] Structures
Aircraft must withstand a dynamic pressure of 2133 psf when flying at Mach 1.2 at sea level
Classification: MUST
Date: 9/27/2024
Objective: 2,133 psf
Required By: RFP
Values: 2,133 psf

### 1.5 [5] Structures
Aircraft must have a safety factor on all loads
Classification: MUST
Date: 9/27/2024
Objective: 1.5
Required By: RFP
Values: 1.5

### 1.6 [6] Structures
The aircraft must have a minimum design service life
Classification: MUST
Date: 9/27/2024
Objective: 2000 hrs
Required By: RFP
Values: 2000 hrs

### 1.7 [7] Stability and Control
The aircraft must have a static margin less than or equal to 10%.
Classification: MUST
Date: 9/27/2024
Objective: ≤ |10%|
Required By: RFP
Values: ≤ |10%|

### 1.8 [8] Mission Performance
The aircraft must perform over the Intercept Mission Radius
Classification: MUST
Date: 9/27/2024
Objective: 200 nm
Required By: RFP
Values: 200 nm

### 1.9 [9] Mission Performance
The aircraft must perform over DCA Mission CAP endurance at 300 nm radius
Classification: MUST
Date: 9/27/2024
Objective: 4 hrs
Required By: RFP
Values: 4 hrs

### 1.10 [10] Performance
The aircraft must reach a specific maximum mach number at maneuver weight (50% internal fuel)
Classification: MUST
Date: 9/27/2024
Objective: 1.6
Required By: RFP
Values: 1.6

### 1.11 [11] Performance
Aircraft must be able to takeoff and land at any NATO runway
Classification: MUST
Date: 9/27/2024
Objective: 4500 ft
Required By: RFP
Values: 8000 ft

### 1.12 [12] Aircraft Systems
The aircraft must have remote pilot capability
Classification: MUST
Date: 9/27/2024
Objective: N/A
Required By: RFP
Values: N/A

### 1.13 [13] Aircraft Systems
Fuel tanks must be self-healing
Classification: MUST
Date: 9/27/2024
Objective: N/A
Required By: RFP
Values: N/A

### 1.14 [14] Project Deadline
The engine selected for the aircraft must be in production or forcast to be in production
Classification: MUST
Date: 9/27/2024
Objective: 2027
Required By: RFP - Attachment 6
Values: 2027

### 1.15 [15] Aircraft Systems
Electrical and hydraulic systems power requirement
Classification: MUST
Date: 9/27/2024
Objective: 50 kW
Required By: RFP - Attachment 6
Values: 50 kW

### 1.16 [16] Aircraft Systems
Environmental control systems and avionics liquid cooling system % of engine mass flow
Classification: MUST
Date: 9/27/2024
Objective: 0.02
Required By: RFP - Attachment 6
Values: 0.02

### 1.17 [17] Payload
The aircraft must have air-to-air weapons systems
Classification: MUST
Date: 9/30/2024
Objective: ≥ 3 AIM-120s
Required By: RFP
Values: Trade AIM-120s

### 1.18 [18] Stability and Control
The aircraft must have a phugoid mode damping ratio less than or equal to .04.
Classification: MUST
Date: 10/19/2024
Objective: ≤ .04
Required By: MIL-F-8785C
Values: ≤ .04

### 1.19 [19] Stability and Control
The aircraft must have a short period mode damping ratio less than or equal to 2.0 and greater than or equal to 0.3.
Classification: MUST
Date: 10/19/2024
Objective: ≤ 2.0 and ≥0.3
Required By: MIL-F-8785C
Values: ≤ 2.0 and ≥0.3

### 1.20 [20] Stability and Control
The aircraft must have a roll subsidence mode period less than or equal to 1.4 seconds.
Classification: MUST
Date: 10/19/2024
Objective: ≤ 1.4s
Required By: MIL-F-8785C
Values: ≤ 1.4s

### 1.21 [21] Stability and Control
The aircraft must have a spiral mode period greater than or equal to 20 seconds.
Classification: MUST
Date: 10/19/2024
Objective: ≥20s
Required By: MIL-F-8785C
Values: ≥20s

### 1.22 [22] Stability and Control
The aircraft must have a dutch roll mode damping ratio greater than or equal to 0.08.
Classification: MUST
Date: 10/19/2024
Objective: ≥0.08
Required By: MIL-F-8785C
Values: ≥0.08

### 1.23 [23] Stability and Control
The static longitudinal (pitch) stability derivative must be less than 0.
Classification: MUST
Date: 10/19/2024
Objective: <0
Required By: FAR Part 23& 25; MIL-HDBK-1797
Values: <0

### 1.24 [24] Stability and Control
The static lateral (roll) stability derivative must be less than zero.
Classification: MUST
Date: 10/19/2024
Objective: <0
Required By: MIL-HDBK-1797
Values: <0

### 1.25 [25] Stability and Control
The static directional (yaw) stability derivative must be greater than zero.
Classification: MUST
Date: 10/19/2024
Objective: >0
Required By: FAR Part 23& 25; MIL-HDBK-1797
Values: >0

### 1.26 [26] Stability and Control
The roll damping derivative should be less than zero for roll-handling qualities.
Classification: SHOULD
Date: 10/19/2024
Objective: <0
Required By: Team
Values: <0

### 1.27 [27] Stability and Control
The pitch damping derivative should be less than zero in order to meet short period damping requirements.
Classification: SHOULD
Date: 10/19/2024
Objective: <0
Required By: Team
Values: <0

### 1.28 [28] Mission Systems
Latency of displayed confirmation of action between UAS and operator doesn't exceed stated value for both Vehicle Motion Control and Weapon System Control
Classification: MUST
Date: 10/19/2024
Objective: <= 100 ms
Required By: MIL-STD-1472G
Values: <= 100 ms

### 1.29 [29] Performance
The aircraft has to have an instantanious turn rate of 18 °/s at 35,000 ft.
Classification: MUST
Date: 10/20/2024
Objective: 20 °/s
Required By: RFP
Values: 18 °/s

### 1.30 [30] Mission Systems
Provides alerts from internal sensors for all conditions listed in Table XXXV
Classification: MUST
Date: 10/24/2024
Objective: yes
Required By: MIL-STD-1472G
Values: Yes

### 1.31 [31] Mission Systems
Contains internal sesnors detailing all vehicle state paramaters for use of pilot in Table XXXVII
Classification: MUST
Date: 10/24/2024
Objective: Yes
Required By: MIL-STD-1472G
Values: Yes

### 1.32 [32] Mission Systems
Contains capability to automatically "return home" to launch base when position is lost for a specified amount of time.
Classification: MUST
Date: 10/24/2024
Objective: 1 hour
Required By: MIL-STD-1472G
Values: 1 hour

### 1.33 [33] Mission Systems
Contains capability to automatically activate "kill switch" when communications are lost for a specified amount of time.
Classification: MUST
Date: 10/24/2024
Objective: 1 hour
Required By: MIL-STD-1472G
Values: 1 hour

### 1.34 [34] Mission Systems
Contains emergency transponder hardware to determine location of vehicle when communications are lost.
Classification: MUST
Date: 10/24/2024
Objective: Yes
Required By: MIL-STD-1472G
Values: Yes

### 1.35 [35] Safety
Aircraft must be capable of take-off and landing on icy runway
Classification: MUST
Date: 10/24/2024
Objective: 4500 ft
Required By: RFP
Values: 8000 ft

### 1.36 [36] Aerodynamics
The vehicles AR must be smaller or equal to 5.
Classification: SHOULD
Date: 11/4/2024
Objective: AR < 5
Required By: Nicolai pg. 181
Values: AR < 5

### 1.37 [37] ConOps
Aircraft shall have the abillity to receive commands from F-22 and/or F-35 pilots.
Date: 2/19/2025

### 1.38 [38] ConOps
Aircraft must be able to receive targeting data from F-22 and/or F-35.
Classification: MUST
Date: 2/19/2025
Objective: Link 16
Values: Link 16

### 1.39 [39] ConOps
Aircraft shall have in-air refueling capabilities.
Date: 2/19/2025
Objective: receptacle (boom KC-135)
Values: receptacle (boom KC-135)

### 1.40 [40] ConOps
Aircraft shall be able to provide visiual of target within 40 nm.
Classification: SHALL
Date: 2/19/2025
Objective: 40 nm
Values: 40 nm

### 1.41 [41] ConOps
Aircraft shall have both static countermeasure and Electronic Countermeasure (ECM) systems
Classification: SHALL
Date: 2/19/2025
Objective: Flares, Chaff, AN/ALQ-131
Values: Flares, Chaff, AN/ALQ-131